# Grasshopper definition analysisRecipe.gh (Grasshopper 0.9.76)
# plug-ins: Python Interpreter

# from honeybeegrasshopper.radiance import radianceparameters
# 
# if _quality:
#     radParameters = radianceparameters.RadianceParameters(_quality)
#     if _ab_: radParameters.ab = _ab_
#     if _ad_: radParameters.ad = _ad_
#     if _as_: radParameters.as_ = _as_
#     if _ar_: radParameters.ar = _ar_
#     if _aa_: radParameters.aa = _aa_
number_slider = Slider(2, range=0..10)
# from honeybeegrasshopper.radiance import sky
# 
# if _illuminanceValue:
#     HBSky = sky.HBCertainIlluminanceLevelSky(_illuminanceValue)
number_slider_2 = Slider(200, range=0..1000)
number_slider_3 = Slider(20, range=0..100)
cir = Circle(Plane=PlaneXY(0, 0, 0), Radius="20")
planesrf = PlaneSurface(Plane=PlaneXY(0, 0, 0), XSize="20", YSize="20")
boundary = BoundarySurfaces(Edges=cir)

# ---- group: Radiance parameters
radpar = PythonScript(quality=number_slider)  # -> radParameters; inputs quality: Int32, ab: Int32, ad: Int32, as: Int32, ar: Int32
# ---------- radpar: Python ----------
import sys
sys.path.append(r"C:\Users\Administrator\Documents\GitHub\honeybee-grasshopper")

from honeybeegrasshopper.radiance import parameters
from honeybeegrasshopper import wrapper

if _quality:
    radParameters = parameters.RadianceParameters(_quality)
    if _ab_: radParameters.ab = _ab_
    if _ad_: radParameters.ad = _ad_
    if _as_: radParameters.as_ = _as_
    if _ar_: radParameters.ar = _ar_
    if _aa_: radParameters.aa = _aa_
    
    #print radParameters
    #wrap the object
    radParameters = wrapper.Wrapper(radParameters)
# ---------- end radpar ----------

# ----
sdivide = DivideSurface(Surface=boundary, UCount=number_slider_3, VCount=number_slider_3)  # -> Points, Normals, Parameters

# ---- group: sky library
sky = PythonScript(illuminanceValue=number_slider_2)  # -> HBSky
# ---------- sky: Python ----------
import sys
sys.path.append(r"C:\Users\Administrator\Documents\GitHub\honeybee-grasshopper")

from honeybeegrasshopper.radiance.sky.certainIlluminance import SkyWithCertainIlluminanceLevel
from honeybeegrasshopper.wrapper import Wrapper
if _illuminanceValue:
    HBSky = Wrapper(SkyWithCertainIlluminanceLevel(_illuminanceValue))
# ---------- end sky ----------

# ----
panel = Panel(radpar)
panel_2 = Panel(sky)

# ---- group: analysis recipe
# from honeybeegrasshopper.radiance import analysisrecipe, sky
# 
# if _skyFile and _testPoints and ptsVectors_:
#     analysisRecipe = analysisrecipe.GridBasedAnalysisRecipe(_skyFile, \
#         _testPoints, ptsVectors_, _radParameters_)
gridbased = PythonScript(skyFile=sky, radParameters=radpar)  # -> analysisRecipe; inputs testPoints: tree of Point3d, ptsVectors: tree of Vector3d
# ---------- gridbased: Python ----------
import sys
sys.path.append(r"C:\Users\Administrator\Documents\GitHub\honeybee-grasshopper")

from honeybeegrasshopper.radiance import analysisrecipe, sky
from honeybeegrasshopper import wrapper

if _skyFile and _testPoints and ptsVectors_:
    if _radParameters_:
        _radParameters_ = _radParameters_.unwrap()
        
#    analysisRecipe = analysisrecipe.GridBasedAnalysisRecipe(_skyFile.unwrap(), \
#        _testPoints, ptsVectors_, _radParameters_)
    
#    analysisRecipe = wrapper.Wrapper(analysisRecipe)
# ---------- end gridbased ----------

# ----
rundaylightanalysis = Honeybee_RunDaylightSimulation(analysisRecipe=gridbased, overwriteResults=True)  # -> readMe, analysisType, resultsUnit, results, testPts, resultFiles, radGeoFile, studyFolder, done; plug-in component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
